# Grasshopper definition Serial_IO_Stepper_Joystick.gh (Grasshopper 1.0.8)
# plug-ins: superSerial

trigger = Trigger(Interval=10, TimerInterval=10, Target=reader)  # disabled

# ---- group: Read & Write
# Serial IO Stepper Joystick
# Reads joystick analog values (2) and compute a location in a circle.
# The distances between the edge of the circle and the center point
# are averaged and remapped into a step count that is sent to the
# steppermotor.
# 
# This definition is to be used with the .ino sketch of the same name.
reader = Python3Script()  # -> data, status
# ---------- reader: Python ----------
# Outputs:
#   data
#   status

import os

buffer_path = os.path.join(os.getenv('TEMP'), "gh_buffer.txt")

if os.path.exists(buffer_path):
    try:
        with open(buffer_path, "r") as f:
            data = f.read()
        status = "Data read successfully"
    except Exception as e:
        data = None
        status = "Read error: {}".format(e)
else:
    data = None
    status = "Buffer file not found"
# ---------- end reader ----------

# ----
panel = Panel(reader.status)
superserial = SuperSerial(Switch=Toggle(False), Baud="115200", Port="COM3", Data=reader.data, Mode="2", Trigger=False)  # -> Info, Out, Read
text_split = TextSplit(Text=superserial.Read, Separators=",")
panel_2 = Panel(superserial.Out)
panel_3 = Panel(superserial.Read)
remap_numbers = RemapNumbers(Value=text_split, Source=Domain(0, 4095), Target=Domain(0, 100))  # -> Mapped, Clipped
dispatch = Dispatch(List=remap_numbers.Mapped, DispatchPattern=[True, False])  # -> ListA, ListB

# ---- group: Compute steppermotor step from joystick values based on circle visualulization
construct_point = ConstructPoint(XCoordinate=dispatch.ListB, YCoordinate=dispatch.ListA, ZCoordinate=0)
point = Point(Point(50, 50, 0))
circle = Circle(Plane=point, Radius=75)
divide_curve = DivideCurve(Curve=circle, Count=10, Kinks=False)  # -> Points, Tangents, Parameters
closest_point = ClosestPoint(Point=point, Cloud=construct_point)  # -> ClosestPoint, CPIndex, Distance
line = Line(StartPoint=divide_curve.Points, EndPoint=closest_point.ClosestPoint)
line_dimension = LineDimension(Line=line, Text="{0:0.00}", Size=5)
length = Length(Curve=line)
average = Average(Input=length)
remap_numbers_2 = RemapNumbers(Value=average, Source=Domain(75, 93), Target=Domain(0, 200))  # -> Mapped, Clipped
integer = Integer(remap_numbers_2.Mapped)
smaller_than = SmallerThan(FirstNumber=integer, SecondNumber=2)  # -> SmallerThan, OrEqualTo
stream_filter = StreamFilter(Gate=smaller_than.OrEqualTo, Stream0=integer, Stream1=0)

# ---- group: Read & Write
writer = Python3Script(data=stream_filter)  # -> status
# ---------- writer: Python ----------
# Inputs:
#   data: string or number to store
# Outputs:
#   status: feedback message for panel

import os

if data is not None:
    buffer_path = os.path.join(os.getenv('TEMP'), "gh_buffer.txt")
    try:
        with open(buffer_path, "w") as f:
            f.write(str(data))
        status = "Data written to: {}".format(buffer_path)
    except Exception as e:
        status = "Write error: {}".format(e)
else:
    status = "No input data received"
# ---------- end writer ----------

# ----
panel_4 = Panel(writer)
