# Grasshopper definition Serial_IO_Stepper_Joystick_Advanced.gh (Grasshopper 1.0.8)
# plug-ins: Heteroptera, Pufferfish, Human, superSerial

trigger = Trigger(Interval=10, TimerInterval=10, Target=reader)  # disabled

# ---- group: Read & Write
# Serial IO Stepper Joystick Advanced
# Reads joystick analog values (2) and compute a location in a circle.
# Then I forgot what I did, but basically, it's rotating the steppermotor
# according to the position of the joystick. And when you move the
# joystick in a circular way, it counts how many circles you do.
# 
# This defenition is to be used with the .ino sketch of the same name.
reader = Python3Script()  # -> data, status
# ---------- reader: Python ----------
# Outputs:
#   data
#   status

import os

buffer_path = os.path.join(os.getenv('TEMP'), "gh_buffer.txt")

if os.path.exists(buffer_path):
    try:
        with open(buffer_path, "r") as f:
            data = f.read()
        status = "Data read successfully"
    except Exception as e:
        data = None
        status = "Read error: {}".format(e)
else:
    data = None
    status = "Buffer file not found"
# ---------- end reader ----------

# ----
panel = Panel(reader.status)
superserial = SuperSerial(Switch=Toggle(False), Baud="115200", Port="COM3", Data=reader.data, Mode="2", Trigger=False)  # -> Info, Out, Read
text_split = TextSplit(Text=superserial.Read, Separators=",")
panel_2 = Panel(superserial.Read)
panel_3 = Panel(superserial.Out)
panel_4 = Panel("""1855
1865""")
snap_to_target_filter = Python3Script(a_list=text_split, b_list=panel_4, threshold=Slider(25, range=0..50))  # -> out, a; inputs a_list: list of Double, b_list: list of Double
# ---------- snap_to_target_filter: Python ----------
"""
Snap-to-Target Filter

Description:
Updates values to match a target only when the difference is within a
specified threshold. Values outside the threshold remain unchanged.
Supports both single numbers and lists.

Inputs:
    a_list   : float or list of floats
               Original value(s) to be filtered.
    b_list   : float or list of floats
               Target value(s) to snap to if within threshold.
    threshold: float
               Maximum difference allowed for snapping.

Output:
    a        : float or list of floats
               Snapped or original value(s) after threshold filtering.
"""


# Check if both inputs are lists
if isinstance(a_list, list) and isinstance(b_list, list):
    result = []
    for ai, bi in zip(a_list, b_list):
        if abs(ai - bi) <= threshold:
            result.append(bi)  # snap to target
        else:
            result.append(ai)  # keep original
else:
    # Single numbers case
    if abs(a_list - b_list) <= threshold:
        result = b_list
    else:
        result = a_list

# Output
a = result
# ---------- end snap_to_target_filter ----------
panel_5 = Panel(snap_to_target_filter.a)
remap_numbers = RemapNumbers(Value=snap_to_target_filter.a, Source=Domain(0, 4095), Target=Domain(50, -50))  # -> Mapped, Clipped
dispatch = Dispatch(List=remap_numbers.Mapped, DispatchPattern=[True, False])  # -> ListA, ListB
number_slider = Slider(75, range=0..100)
point = Point(Point(0, 0, 0))
construct_point = ConstructPoint(XCoordinate=expr("x-4.35", dispatch.ListB), YCoordinate=expr("x+0", dispatch.ListA), ZCoordinate=0)
point_2 = Point(construct_point)
circle = Circle(Plane=point, Radius=number_slider)
vector_2pt = Vector2Pt(PointA=point, PointB=point_2, Unitize=False)  # -> Vector, Length
offset_curve = OffsetCurve(Curve=circle, Distance=35, Corners=1)
vector_display = VectorDisplay(Anchor=point, Vector=vector_2pt.Vector)
unit_y = UnitY(Factor=1)
curve_closest_point = CurveClosestPoint(Point=point_2, Curve=circle)  # -> Point, Parameter, Distance
curve_closest_point_2 = CurveClosestPoint(Point=point_2, Curve=offset_curve)  # -> Point, Parameter, Distance
angle = Angle(VectorA=vector_2pt.Vector, VectorB=unit_y, Plane=PlaneXY(0, 0, 0))  # -> Angle, Reflex
dot_display = DotDisplay(Point=curve_closest_point.Point, Colour=RGB(34, 0, 255), Size=10)
degrees = Degrees(Radians=angle.Angle)
data_recorder_max = Python3Script(data=degrees, record=True, max_records=2)  # -> recorded_output; inputs data: Double, reset: Boolean, record: Boolean, max_records: Int32
# ---------- data_recorder_max: Python ----------
"""
Data Recorder with Maximum Capacity

Description:
Records incoming data values over time, storing them in a list. The
recording can be reset, and a maximum number of records can be specified.
Older values are automatically discarded when the maximum is exceeded.

Inputs:
    data        : any type
                  Value to record.
    record      : bool
                  If True, the input value is recorded.
    reset       : bool
                  If True, clears all previously recorded data.
    max_records : int (optional)
                  Maximum number of records to store (default: 100).

Output:
    recorded_output : list
                      List of recorded data values, up to max_records.
"""

import rhinoscriptsyntax as rs
import scriptcontext as sc
import Grasshopper as gh

# Initialize recorded data storage
if 'recorded_data' not in globals() or reset:
    recorded_data = []  # Reset the recorded data when reset button is pressed

# Set maximum number of records (connect this to Grasshopper input)
if 'max_records' not in globals():
    max_records = 100  # Default fallback

# Append new data if recording is enabled
if record:
    recorded_data.append(data)  # 'data' is the input value to record

    # Remove oldest items if we exceed max_records
    while len(recorded_data) > max_records:
        recorded_data.pop(0)  # Remove first (oldest) item

# Output recorded data
recorded_output = recorded_data
# ---------- end data_recorder_max ----------
list_item = ListItem(List=data_recorder_max, Index=0, Wrap=True)  # -> Item, Item1
subtraction = Subtraction(A=list_item.Item1, B=list_item.Item)
angle_wrap_filter = Python3Script(x=subtraction)  # -> a
# ---------- angle_wrap_filter: Python ----------
"""
Angle Wrap Filter

Description:
Normalizes an input angle into the range [-300, 300] degrees. 
Angles beyond this range are wrapped by adding or subtracting 360 degrees.

Inputs:
    x : float
        Input angle in degrees.

Output:
    a : float
        Wrapped angle within [-300, 300].
"""

# Assume 'x' comes in as an input
if x >= 300:
    result = x - 360
elif x <= -300:
    result = x + 360
else:
    result = x

# Output
a = result  # Connect 'a' to the Grasshopper output
# ---------- end angle_wrap_filter ----------
running_total_accumulator = Python3Script(reset=Button(), x=angle_wrap_filter)  # -> out, a; inputs reset: Boolean
# ---------- running_total_accumulator: Python ----------
"""
Running Total Accumulator

Description:
Keeps a cumulative sum of incoming numbers. The total persists across
component updates and can be reset when needed.

Inputs:
    x     : float
            New number to add to the running total.
    reset : bool
            If True, resets the total to zero.

Output:
    a     : float
            Current running total.
"""

# Initialize total if not already set or if reset is True
if 'total' not in globals() or reset:
    total = 0

# Add new incoming value
total += x  # where 'x' is your input number

# Output the running total
a = total
# ---------- end running_total_accumulator ----------
panel_6 = Panel(running_total_accumulator.a)
remap_numbers_2 = RemapNumbers(Value=running_total_accumulator.a, Source=Domain(0, 360), Target=Domain(0, 200))  # -> Mapped, Clipped

# ---- group: Preview
glitch_reduction = GlitchReduction(Number=running_total_accumulator.a, Range=1, Tolerance=0.5)  # -> Smooth, DeGlitched
construct_domain = ConstructDomain(DomainStart=running_total_accumulator.a, DomainEnd=0)
radians = Radians(Degrees=construct_domain)
division = Division(A=glitch_reduction.Smooth, B=360)
round_to_decimal_place = RoundToDecimalPlace(NumberX=glitch_reduction.Smooth, DecimalPlace=1, RoundType=0)  # -> Rounded, Difference
arc = Arc(Plane=PlaneXY(0, 0, 0), Radius=number_slider, Angle=radians)  # -> Arc, Length
round = Round(Number=division)  # -> Nearest, Floor, Ceiling
concatenate = Concatenate(FragmentA="x ", FragmentB=round.Floor)
concatenate_2 = Concatenate(FragmentA=round_to_decimal_place.Rounded, FragmentB=" °")
rotate = Rotate(Geometry=arc.Arc, Angle=degrees(90), Plane=PlaneXY(0, 0, 0))  # -> Geometry, Transform
number_of_rotation = JustifiedText3d(
    Location=PlaneXY(75, 125, 0),
    Text=concatenate,
    Size=10,
    Color=RGB(0, 0, 0),
    HorizontalAlignment=0,
    VerticalAlginment=0,
    Font="Funnel Display",
    UseMeshes=False,
    Bake=False)
angle_2 = JustifiedText3d(
    Location=curve_closest_point_2.Point,
    Text=concatenate_2,
    Size=10,
    Color=RGB(0, 0, 0),
    HorizontalAlignment=1,
    VerticalAlginment=1,
    Font="Funnel Display",
    UseMeshes=False,
    Bake=False)
custom_preview_lineweights = CustomPreviewLineweights(
    Geometry=rotate.Geometry,
    Shader={diffuse=RGB(0, 0, 0), emission=RGB(0, 0, 0), shine=0.5, specular=RGB(255, 255, 255), transparency=0},
    Thickness=20,
    Absolute=False)

# ----
integer = Integer(remap_numbers_2.Mapped)
panel_7 = Panel(integer)

# ---- group: Read & Write
writer = Python3Script(data=integer)  # -> status
# ---------- writer: Python ----------
# Inputs:
#   data: string or number to store
# Outputs:
#   status: feedback message for panel

import os

if data is not None:
    buffer_path = os.path.join(os.getenv('TEMP'), "gh_buffer.txt")
    try:
        with open(buffer_path, "w") as f:
            f.write(str(data))
        status = "Data written to: {}".format(buffer_path)
    except Exception as e:
        status = "Write error: {}".format(e)
else:
    status = "No input data received"
# ---------- end writer ----------

# ----
panel_8 = Panel(writer)
