# Grasshopper definition Serial_IO_Stepper_Photoresistor.gh (Grasshopper 1.0.8)
# plug-ins: Heteroptera, superSerial

trigger = Trigger(Interval=10, TimerInterval=10, Target=reader)  # disabled

# ---- group: Read & Write
# Serial IO Stepper Photoresistor
# Reads photoresistor analog value and remaps them into steppermotor steps.
# These analog values are displayed in the viewport with a cricle and an arrow.
# 
# This defenition is to be used with the .ino sketch of the same name.
reader = Python3Script()  # -> data, status
# ---------- reader: Python ----------
# Outputs:
#   data
#   status

import os

buffer_path = os.path.join(os.getenv('TEMP'), "gh_buffer.txt")

if os.path.exists(buffer_path):
    try:
        with open(buffer_path, "r") as f:
            data = f.read()
        status = "Data read successfully"
    except Exception as e:
        data = None
        status = "Read error: {}".format(e)
else:
    data = None
    status = "Buffer file not found"
# ---------- end reader ----------

# ----
panel = Panel(reader.status)
superserial = SuperSerial(Switch=Toggle(False), Baud="115200", Port="COM3", Data=reader.data, Mode="2", Trigger=False)  # -> Info, Out, Read
panel_2 = Panel(superserial.Out)
number = Number(superserial.Read)
panel_3 = Panel(superserial.Read)
remap_numbers = RemapNumbers(Value=number, Source=Domain(480, 20), Target=Domain(0, 1))  # -> Mapped, Clipped
remap_numbers_2 = RemapNumbers(Value=remap_numbers.Mapped, Source=Domain(0, 1), Target=Domain(0, 200))  # -> Mapped, Clipped

# ---- group: Visualization
number_2 = Number(number)
number_3 = Number(remap_numbers.Mapped)
remap_numbers_3 = RemapNumbers(Value=number_3, Source=Domain(0, 1), Target=Domain(0, 150))  # -> Mapped, Clipped
gradient = Gradient(
    LowerLimit=10,
    UpperLimit=150,
    Parameter=remap_numbers_3.Mapped,
    stops=[0: RGB(234, 38, 0), 0.25: RGB(234, 126, 0), 0.5: RGB(254, 244, 84), 0.75: RGB(173, 203, 249), 1: RGB(75, 107, 169)])
circle = Circle(Plane=PlaneXY(0, 0, 0), Radius=remap_numbers_3.Mapped)
boundary_surfaces = BoundarySurfaces(Edges=circle)
custom_preview = CustomPreview(Geometry=boundary_surfaces, Material=gradient)
lux_converter = Python3Script(analog_val=number_2)  # -> a
# ---------- lux_converter: Python ----------
'''
Input: analog_val
Ouput: a

Converts 12bits Analog values into Lux
'''

import math

# Constants
adc_max = 4095         # 12-bit ADC
v_ref = 3.3            # Reference voltage
r_known = 10000        # Ohms

# Ensure input is valid
if analog_val is None:
    a = None
else:
    voltage = analog_val * (v_ref / adc_max)

    if voltage <= 0 or voltage >= v_ref:
        a = 0
    else:
        r_ldr = (voltage * r_known) / (v_ref - voltage)
        a = 500 / ((r_ldr / 1000.0) ** 1.25)
# ---------- end lux_converter ----------
evaluate_curve = EvaluateCurve(Curve=reparameterize(circle), Parameter=number_3)  # -> Point, Tangent, Angle
glitch_reduction = GlitchReduction(Number=lux_converter, Range=10, Tolerance=0)  # -> Smooth, DeGlitched
line = Line(StartPoint=Point(0, 0, 0), EndPoint=evaluate_curve.Point)
extend_curve = ExtendCurve(Curve=line, Type=0, Start=0, End=50)
unit_vector = UnitVector(Vector=line)
end_points = EndPoints(Curve=extend_curve)  # -> Start, End
end_points_2 = EndPoints(Curve=line)  # -> Start, End
integer = Integer(glitch_reduction.Smooth)
move = Move(Geometry=end_points.End, Motion=Vector(0, 10, 0))  # -> Geometry, Transform
vector_display = VectorDisplay(Anchor=end_points_2.End, Vector=unit_vector)
concatenate = Concatenate(FragmentA=integer, FragmentB=" Lux")
text_tag = TextTag(Location=move.Geometry, Text=concatenate, Colour=RGB(0, 0, 0))

# ----
integer_2 = Integer(remap_numbers_2.Mapped)
panel_4 = Panel(integer_2)

# ---- group: Read & Write
writer = Python3Script(data=integer_2)  # -> status
# ---------- writer: Python ----------
# Inputs:
#   data: string or number to store
# Outputs:
#   status: feedback message for panel

import os

if data is not None:
    buffer_path = os.path.join(os.getenv('TEMP'), "gh_buffer.txt")
    try:
        with open(buffer_path, "w") as f:
            f.write(str(data))
        status = "Data written to: {}".format(buffer_path)
    except Exception as e:
        status = "Write error: {}".format(e)
else:
    status = "No input data received"
# ---------- end writer ----------

# ----
panel_5 = Panel(writer)
