# Grasshopper definition Serial_IO_Stepper_Ultrasonic.gh (Grasshopper 1.0.8)
# plug-ins: Heteroptera, Human, superSerial

trigger = Trigger(Interval=10, TimerInterval=10, Target=reader)  # disabled

# ---- group: Read & Write
# Serial IO Stepper Ultrasonic
# Reads ultrasonic sensor analog value and converts it into a distance
# in cm and displays it as a HUD.
# The distances is also remapped into a step count that is sent to the
# steppermotor.
# 
# This definition is to be used with the .ino sketch of the same name.
reader = Python3Script()  # -> data, status
# ---------- reader: Python ----------
# Outputs:
#   data
#   status

import os

buffer_path = os.path.join(os.getenv('TEMP'), "gh_buffer.txt")

if os.path.exists(buffer_path):
    try:
        with open(buffer_path, "r") as f:
            data = f.read()
        status = "Data read successfully"
    except Exception as e:
        data = None
        status = "Read error: {}".format(e)
else:
    data = None
    status = "Buffer file not found"
# ---------- end reader ----------

# ----
panel = Panel(reader.status)
number_slider = Slider(17, range=0..100)
superserial = SuperSerial(Switch=Toggle(False), Baud="115200", Port="COM3", Data=reader.data, Mode="2", Trigger=False)  # -> Info, Out, Read
number = Number(superserial.Read)
panel_2 = Panel(superserial.Out)
expression = Expression(x=number, y=number_slider, Expression="If(x>y, y, x)")
remap_numbers = RemapNumbers(Value=expression, Source=number_slider, Target=Domain(0, 1))  # -> Mapped, Clipped
remap_numbers_2 = RemapNumbers(Value=remap_numbers.Mapped, Source=Domain(0, 1), Target=Domain(0, 200))  # -> Mapped, Clipped
integer = Integer(remap_numbers_2.Mapped)
panel_3 = Panel(integer)

# ---- group: Read & Write
writer = Python3Script(data=integer)  # -> status
# ---------- writer: Python ----------
# Inputs:
#   data: string or number to store
# Outputs:
#   status: feedback message for panel

import os

if data is not None:
    buffer_path = os.path.join(os.getenv('TEMP'), "gh_buffer.txt")
    try:
        with open(buffer_path, "w") as f:
            f.write(str(data))
        status = "Data written to: {}".format(buffer_path)
    except Exception as e:
        status = "Write error: {}".format(e)
else:
    status = "No input data received"
# ---------- end writer ----------

# ---- group: Visualization
line_sdl = LineSDL(Start=Point(0, 0, 0), Direction=Vector(0, 1, 0), Length=150)
custom_preview_lineweights = CustomPreviewLineweights(
    Geometry=line_sdl,
    Shader={diffuse=RGB(0, 0, 0), emission=RGB(0, 0, 0), shine=0.5, specular=RGB(255, 255, 255), transparency=0},
    Thickness=5,
    Absolute=False)
evaluate_curve = EvaluateCurve(Curve=reparameterize(line_sdl), Parameter=remap_numbers.Mapped)  # -> Point, Tangent, Angle
dot_display = DotDisplay(Point=evaluate_curve.Point, Colour=RGB(34, 0, 255), Size=10)
line = Line(StartPoint=Point(0, 0, 0), EndPoint=evaluate_curve.Point)
extend_curve = ExtendCurve(Curve=line, Type=0, Start=0, End=-7.5)
end_points = EndPoints(Curve=line_sdl)  # -> Start, End
custom_preview_lineweights_2 = CustomPreviewLineweights(
    Geometry=extend_curve,
    Shader={diffuse=RGB(181, 0, 0), emission=RGB(54, 0, 0), shine=0.5, specular=RGB(255, 255, 255), transparency=0},
    Thickness=20,
    Absolute=False)
unit_y = UnitY(Factor=extend_curve)
glitch_reduction = GlitchReduction(Number=expression, Range=1, Tolerance=0.5)  # -> Smooth, DeGlitched
curve_middle = CurveMiddle(Curve=extend_curve)
unit_x = UnitX(Factor=20)
vector_display = VectorDisplay(Anchor=Point(0, 0, 0), Vector=unit_y)
integer_2 = Integer(glitch_reduction.Smooth)
move = Move(Geometry=curve_middle, Motion=Vector(20, 0, 0))  # -> Geometry, Transform
concatenate = Concatenate(FragmentA=integer_2, FragmentB=" cm")
move_2 = Move(Geometry=end_points.End, Motion=unit_x)  # -> Geometry, Transform
text = JustifiedText3d(
    Location=PlaneXY(20, 0, 0),
    Text="0",
    Size=10,
    Color=RGB(0, 0, 0),
    HorizontalAlignment=0,
    VerticalAlginment=2,
    Font="Funnel Display",
    UseMeshes=False,
    Bake=False)
text_2 = JustifiedText3d(
    Location=move_2.Geometry,
    Text=number_slider,
    Size=10,
    Color=RGB(0, 0, 0),
    HorizontalAlignment=0,
    VerticalAlginment=0,
    Font="Funnel Display",
    UseMeshes=False,
    Bake=False)
length = JustifiedText3d(
    Location=move.Geometry,
    Text=concatenate,
    Size=10,
    Color=RGB(0, 0, 0),
    HorizontalAlignment=0,
    VerticalAlginment=1,
    Font="Funnel Display",
    UseMeshes=False,
    Bake=False)

# ----
panel_4 = Panel(writer)
