# Grasshopper definition ESP-NOW_Multimotors_Attractor.gh (Grasshopper 1.0.8)
# plug-ins: Heteroptera, Human, superSerial

# ---- group: Attractor Point
md_slider = MDSlider(
    SliderMode=0,
    slider_value=Point(0.1666722153, 0.440958907, 0.5),
    x_domain=Domain(0, 1),
    y_domain=Domain(0, 1),
    z_domain=Domain(0, 1))
# ESP-NOW Multimotors Attractor
# Attractor point is moved in grasshopper to interact with HUD circles.
# Steppermotor steps are computed from this interaction and sent to
# the corresponding motor.
# 
# This definition is to be used with the .ino sketch of the same name.
surface = Surface(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)
evaluate_surface = EvaluateSurface(Surface=reparameterize(surface), Point=md_slider)  # -> Point, Normal, UDirection, VDirection, Frame
dot_display = DotDisplay(Point=evaluate_surface.Point, Colour=RGB(0, 0, 0), Size=15)

# ----
point = Point(Point(0, 0, 0))
point_2 = Point(Point(232.5234266, 322.1794958, 0))
point_3 = Point(Point(211.6455366, -471.3639237, 0))
merge = Merge(Data1=point, Data2=point_2, Data3=point_3)
closest_point = ClosestPoint(Point=evaluate_surface.Point, Cloud=merge)  # -> ClosestPoint, CPIndex, Distance
closest_point_2 = ClosestPoint(Point=merge, Cloud=evaluate_surface.Point)  # -> ClosestPoint, CPIndex, Distance
construct_domain = ConstructDomain(DomainStart=1050, DomainEnd=0)
list_item = ListItem(List=closest_point_2.Distance, Index=0, Wrap=True)  # -> Item, Item1, Item2

# ---- group: Circle 1
remap_numbers = RemapNumbers(Value=list_item.Item, Source=construct_domain, Target=Domain(0, 1))  # -> Mapped, Clipped
remap_numbers_2 = RemapNumbers(Value=remap_numbers.Mapped, Source=Domain(0, 1), Target=Domain(0, 150))  # -> Mapped, Clipped
gradient = Gradient(
    LowerLimit=10,
    UpperLimit=150,
    Parameter=remap_numbers_2.Mapped,
    stops=[0: RGB(234, 38, 0), 0.25: RGB(234, 126, 0), 0.5: RGB(254, 244, 84), 0.75: RGB(173, 203, 249), 1: RGB(75, 107, 169)])
circle = Circle(Plane=point, Radius=remap_numbers_2.Mapped)
boundary_surfaces = BoundarySurfaces(Edges=circle)
evaluate_curve = EvaluateCurve(Curve=reparameterize(circle), Parameter=remap_numbers.Mapped)  # -> Point, Tangent, Angle
custom_preview_lineweights = CustomPreviewLineweights(
    Geometry=circle,
    Shader={diffuse=RGB(0, 0, 0), emission=RGB(0, 0, 0), shine=0.5, specular=RGB(255, 255, 255), transparency=0},
    Thickness=3,
    Absolute=False)
custom_preview = CustomPreview(Geometry=boundary_surfaces, Material=gradient)
line = Line(StartPoint=point, EndPoint=evaluate_curve.Point)
remap_numbers_3 = RemapNumbers(Value=remap_numbers.Mapped, Source=Domain(0, 1), Target=Domain(0, 200))  # -> Mapped, Clipped
unit_vector = UnitVector(Vector=line)
end_points = EndPoints(Curve=line)  # -> Start, End
extend_curve = ExtendCurve(Curve=line, Type=0, Start=0, End=50)
glitch_reduction = GlitchReduction(Number=remap_numbers_3.Mapped, Range=10, Tolerance=0)  # -> Smooth, DeGlitched
vector_display = VectorDisplay(Anchor=end_points.End, Vector=unit_vector)
end_points_2 = EndPoints(Curve=extend_curve)  # -> Start, End
integer = Integer(glitch_reduction.Smooth)
move = Move(Geometry=end_points_2.End, Motion=Vector(0, 10, 0))  # -> Geometry, Transform
concatenate = Concatenate(FragmentA=integer, FragmentB=" Steps")
length = JustifiedText3d(
    Location=move.Geometry,
    Text=concatenate,
    Size=10,
    Color=RGB(0, 0, 0),
    HorizontalAlignment=1,
    VerticalAlginment=1,
    Font="Funnel Display",
    UseMeshes=False,
    Bake=False)

# ---- group: Circle 2
remap_numbers_4 = RemapNumbers(Value=list_item.Item1, Source=construct_domain, Target=Domain(0, 1))  # -> Mapped, Clipped
remap_numbers_5 = RemapNumbers(Value=remap_numbers_4.Mapped, Source=Domain(0, 1), Target=Domain(0, 150))  # -> Mapped, Clipped
gradient_2 = Gradient(
    LowerLimit=10,
    UpperLimit=150,
    Parameter=remap_numbers_5.Mapped,
    stops=[0: RGB(234, 38, 0), 0.25: RGB(234, 126, 0), 0.5: RGB(254, 244, 84), 0.75: RGB(173, 203, 249), 1: RGB(75, 107, 169)])
circle_2 = Circle(Plane=point_2, Radius=remap_numbers_5.Mapped)
boundary_surfaces_2 = BoundarySurfaces(Edges=circle_2)
evaluate_curve_2 = EvaluateCurve(Curve=reparameterize(circle_2), Parameter=remap_numbers_4.Mapped)  # -> Point, Tangent, Angle
custom_preview_lineweights_2 = CustomPreviewLineweights(
    Geometry=circle_2,
    Shader={diffuse=RGB(0, 0, 0), emission=RGB(0, 0, 0), shine=0.5, specular=RGB(255, 255, 255), transparency=0},
    Thickness=3,
    Absolute=False)
custom_preview_2 = CustomPreview(Geometry=boundary_surfaces_2, Material=gradient_2)
line_2 = Line(StartPoint=point_2, EndPoint=evaluate_curve_2.Point)
end_points_3 = EndPoints(Curve=line_2)  # -> Start, End
unit_vector_2 = UnitVector(Vector=line_2)
remap_numbers_6 = RemapNumbers(Value=remap_numbers_4.Mapped, Source=Domain(0, 1), Target=Domain(0, 200))  # -> Mapped, Clipped
extend_curve_2 = ExtendCurve(Curve=line_2, Type=0, Start=0, End=50)
vector_display_2 = VectorDisplay(Anchor=end_points_3.End, Vector=unit_vector_2)
glitch_reduction_2 = GlitchReduction(Number=remap_numbers_6.Mapped, Range=10, Tolerance=0)  # -> Smooth, DeGlitched
end_points_4 = EndPoints(Curve=extend_curve_2)  # -> Start, End
integer_2 = Integer(glitch_reduction_2.Smooth)
move_2 = Move(Geometry=end_points_4.End, Motion=Vector(0, 10, 0))  # -> Geometry, Transform
concatenate_2 = Concatenate(FragmentA=integer_2, FragmentB=" Steps")
length_2 = JustifiedText3d(
    Location=move_2.Geometry,
    Text=concatenate_2,
    Size=10,
    Color=RGB(0, 0, 0),
    HorizontalAlignment=1,
    VerticalAlginment=1,
    Font="Funnel Display",
    UseMeshes=False,
    Bake=False)

# ---- group: Circle 3
remap_numbers_7 = RemapNumbers(Value=list_item.Item2, Source=construct_domain, Target=Domain(0, 1))  # -> Mapped, Clipped
remap_numbers_8 = RemapNumbers(Value=remap_numbers_7.Mapped, Source=Domain(0, 1), Target=Domain(0, 150))  # -> Mapped, Clipped
gradient_3 = Gradient(
    LowerLimit=20,
    UpperLimit=150,
    Parameter=remap_numbers_8.Mapped,
    stops=[0: RGB(234, 38, 0), 0.25: RGB(234, 126, 0), 0.5: RGB(254, 244, 84), 0.75: RGB(173, 203, 249), 1: RGB(75, 107, 169)])
circle_3 = Circle(Plane=point_3, Radius=remap_numbers_8.Mapped)
boundary_surfaces_3 = BoundarySurfaces(Edges=circle_3)
custom_preview_lineweights_3 = CustomPreviewLineweights(
    Geometry=circle_3,
    Shader={diffuse=RGB(0, 0, 0), emission=RGB(0, 0, 0), shine=0.5, specular=RGB(255, 255, 255), transparency=0},
    Thickness=3,
    Absolute=False)
custom_preview_3 = CustomPreview(Geometry=boundary_surfaces_3, Material=gradient_3)
evaluate_curve_3 = EvaluateCurve(Curve=reparameterize(circle_3), Parameter=remap_numbers_7.Mapped)  # -> Point, Tangent, Angle
remap_numbers_9 = RemapNumbers(Value=remap_numbers_7.Mapped, Source=Domain(0, 1), Target=Domain(0, 200))  # -> Mapped, Clipped
line_3 = Line(StartPoint=point_3, EndPoint=evaluate_curve_3.Point)
glitch_reduction_3 = GlitchReduction(Number=remap_numbers_9.Mapped, Range=10, Tolerance=0)  # -> Smooth, DeGlitched
extend_curve_3 = ExtendCurve(Curve=line_3, Type=0, Start=0, End=50)
end_points_5 = EndPoints(Curve=line_3)  # -> Start, End
unit_vector_3 = UnitVector(Vector=line_3)
integer_3 = Integer(glitch_reduction_3.Smooth)
end_points_6 = EndPoints(Curve=extend_curve_3)  # -> Start, End
vector_display_3 = VectorDisplay(Anchor=end_points_5.End, Vector=unit_vector_3)
concatenate_3 = Concatenate(FragmentA=integer_3, FragmentB=" Steps")
move_3 = Move(Geometry=end_points_6.End, Motion=Vector(0, 10, 0))  # -> Geometry, Transform
length_3 = JustifiedText3d(
    Location=move_3.Geometry,
    Text=concatenate_3,
    Size=10,
    Color=RGB(0, 0, 0),
    HorizontalAlignment=1,
    VerticalAlginment=1,
    Font="Funnel Display",
    UseMeshes=False,
    Bake=False)

# ---- group: Line Closest Point
merge_2 = Merge(Data1=circle, Data2=circle_2, Data3=circle_3)
point_in_curve = PointInCurve(Point=closest_point.ClosestPoint, Curve=merge_2)  # -> Relationship, Point
expression = Expression(x=point_in_curve.Relationship, Expression="If(x=2, 1, 0)")
cull_pattern = CullPattern(List=merge_2, CullPattern=expression)
curve_closest_point = CurveClosestPoint(Point=evaluate_surface.Point, Curve=cull_pattern)  # -> Point, Parameter, Distance
line_4 = Line(StartPoint=evaluate_surface.Point, EndPoint=curve_closest_point.Point)

# ----
round = Round(Number=remap_numbers_6.Mapped)  # -> Nearest, Floor, Ceiling
round_2 = Round(Number=remap_numbers_3.Mapped)  # -> Nearest, Floor, Ceiling
round_3 = Round(Number=remap_numbers_9.Mapped)  # -> Nearest, Floor, Ceiling
merge_3 = Merge(Data1=round.Nearest, Data2=round_2.Nearest, Data3=round_3.Nearest)
cluster = Cluster(number=merge_3)

# ---- group: Alternative Formating Script
number = Number(merge_3)  # disabled
format_string = Python3Script(x=number)  # -> a; inputs x: list
# ---------- format_string: Python ----------
output = []

for i, val in enumerate(x):
    letter = chr(65 + i)  # A = 65 in ASCII
    output.append("{},{}".format(letter, val))

formatted_string = ";".join(output)

# Output
a = formatted_string
# ---------- end format_string ----------
panel = Panel(format_string)

# ----
superserial = SuperSerial(Switch=Toggle(False), Baud="115200", Port="COM8", Data=cluster, Mode="2", Trigger=False)  # -> Info, Out, Read
serial_print = Panel(superserial.Read)
panel_2 = Panel(superserial.Out)

# ==== cluster Cluster
number = ClusterInput()
number_2 = Number(number)
list_length = ListLength(List=number_2)
char_sequence = CharSequence(Count=list_length, CharPool="ABCDEFGHIJKLMNOPQRSTUVWXYZ", Format="{0}")
format = Format(Format="{0},{1}", Culture=127, Data0=char_sequence, Data1=number_2)
text_join = TextJoin(Text=format, Join=";")
result = ClusterOutput(text_join)
