# Grasshopper definition Reader_Writer.gh (Grasshopper 1.0.8)
# plug-ins: superSerial

trigger = Trigger(Interval=10, TimerInterval=10, Target=reader)
# Reader Writer
# Reads and writes data to a temp. folder.
# Works in tandem with Serial communication.
# Allows for the development of realtime computational
# IOT workflows based in Grasshopper.
boolean_toggle = BooleanToggle(False)

# ---- group: Reader & Writer
reader = Python3Script()  # -> data, status
# ---------- reader: Python ----------
# Outputs:
#   data
#   status

import os

buffer_path = os.path.join(os.getenv('TEMP'), "gh_buffer.txt")

if os.path.exists(buffer_path):
    try:
        with open(buffer_path, "r") as f:
            data = f.read()
        status = "Data read successfully"
    except Exception as e:
        data = None
        status = "Read error: {}".format(e)
else:
    data = None
    status = "Buffer file not found"
# ---------- end reader ----------
panel = Panel(reader.status)

# ----
superserial = SuperSerial(Switch=boolean_toggle, Baud="115200", Port="COM3", Data=reader.data, Mode="2", Trigger=False)  # -> Info, Out, Read
panel_2 = Panel(superserial.Out)
panel_3 = Panel(superserial.Read)

# ---- group: Reader & Writer (continued)
writer = Python3Script(data=superserial.Read)  # -> status
# ---------- writer: Python ----------
# Inputs:
#   data: string or number to store
# Outputs:
#   status: feedback message for panel

import os

if data is not None:
    buffer_path = os.path.join(os.getenv('TEMP'), "gh_buffer.txt")
    try:
        with open(buffer_path, "w") as f:
            f.write(str(data))
        status = "Data written to: {}".format(buffer_path)
    except Exception as e:
        status = "Write error: {}".format(e)
else:
    status = "No input data received"
# ---------- end writer ----------
panel_4 = Panel(writer)
