# Grasshopper definition Threshold_Hold_Filter.gh (Grasshopper 1.0.8)

trigger = Trigger(Interval=10, TimerInterval=10, Target=number_slider)
number_slider = Slider(33.41, range=0..100)
panel = Panel("""1700
1900""")
panel_2 = Panel("""1855
1865""")
number = Number(number_slider)
threshold_hold_filter = Python3Script(x=number, threshold=Slider(9, range=0..10), reset=Button())  # -> out, a; inputs x: list of Double, threshold: Double, reset: Boolean
# ---------- threshold_hold_filter: Python ----------
"""
Threshold-Based State Hold Filter

Description:
A stateful filter that stabilizes noisy inputs by only updating output
when the change exceeds a specified threshold. Small fluctuations are
ignored, and the previous value is held. Supports single values and lists.

Inputs:
    x        : float or list of floats
               Incoming value(s) to be filtered.
    threshold: float
               Minimum change required to update the output.
    reset    : bool
               If True, reinitializes the filter with current input.

Output:
    a        : float or list of floats
               Filtered output; updates only on meaningful changes.
"""

# Initialize previous values
if 'prev_x' not in globals() or reset:
    prev_x = x

# Check if inputs are lists or single values
if isinstance(x, list):
    # Make sure prev_x is a list of same length
    if not isinstance(prev_x, list) or len(prev_x) != len(x):
        prev_x = x

    result = []
    for xi, pxi in zip(x, prev_x):
        if abs(xi - pxi) >= threshold:
            result.append(xi)
        else:
            result.append(pxi)
    prev_x = result  # update previous values to the current filtered result
else:
    if abs(x - prev_x) >= threshold:
        result = x
        prev_x = x
    else:
        result = prev_x

# Output
a = result
# ---------- end threshold_hold_filter ----------
snap_to_target_filter = Python3Script(a_list=panel, b_list=panel_2, threshold=Slider(25, range=0..50))  # -> out, a; inputs a_list: list of Double, b_list: list of Double
# ---------- snap_to_target_filter: Python ----------
"""
Snap-to-Target Filter

Description:
Updates values to match a target only when the difference is within a
specified threshold. Values outside the threshold remain unchanged.
Supports both single numbers and lists.

Inputs:
    a_list   : float or list of floats
               Original value(s) to be filtered.
    b_list   : float or list of floats
               Target value(s) to snap to if within threshold.
    threshold: float
               Maximum difference allowed for snapping.

Output:
    a        : float or list of floats
               Snapped or original value(s) after threshold filtering.
"""


# Check if both inputs are lists
if isinstance(a_list, list) and isinstance(b_list, list):
    result = []
    for ai, bi in zip(a_list, b_list):
        if abs(ai - bi) <= threshold:
            result.append(bi)  # snap to target
        else:
            result.append(ai)  # keep original
else:
    # Single numbers case
    if abs(a_list - b_list) <= threshold:
        result = b_list
    else:
        result = a_list

# Output
a = result
# ---------- end snap_to_target_filter ----------
panel_3 = Panel(threshold_hold_filter.a)
panel_4 = Panel(snap_to_target_filter.a)
